# Grasshopper definition Grasshopper-Python-Hyperboloid.gh (Grasshopper 1.0.7)

number_slider = Slider(50, range=0..100)
ghpython_script = GhPythonScript(x=number_slider, n=number_slider)  # -> out, a, b, l; inputs x: Int32, n: Int32
# ---------- ghpython_script: Python ----------
import rhinoscriptsyntax as rs

a = []
b = []
l = []

for i in range(x):
    a.append(i)
    
print(a)

b = a[::-1]
print(b)

for i in range(n):
    lines = l.append(rs.AddLine(rs.AddPoint(a[i],0,0),rs.AddPoint(0,b[i],0)))
# ---------- end ghpython_script ----------
line = Line(ghpython_script.l)
panel = Panel(line)
